# Dynamo graph ROTINA - SOLO GRAMPEADO.dyn (Dynamo 2.12.1.8246)
# packages: spring nodes 210.1.1

# group: IMPORTAR COORDENADAS EXCEL
file_path = Filename("..\01. CONTENÇÕES\05. CS05 SG +CT\Revit\COORDENADAS DOS GRAMPOS.xlsx")
file_from_path = FileObject(path=file_path)
string = StringInput("SOLIDO 1")
boolean = BoolSelector(false)
importExcel = Data.ImportExcel(file=file_from_path, sheetName=string, showExcel=boolean)

# group: TRANSFORMAR A LISTA EM PONTOS
transpose = List.Transpose(lists=importExcel)
number_slider = DoubleSlider(2, range=1..3 step 1)
getItemAtIndex = List.GetItemAtIndex(list=transpose, index=number_slider)
number_slider_2 = DoubleSlider(1, range=1..3 step 1)
getItemAtIndex_2 = List.GetItemAtIndex(list=transpose, index=number_slider_2)
number_slider_3 = DoubleSlider(3, range=1..3 step 1)
getItemAtIndex_3 = List.GetItemAtIndex(list=transpose, index=number_slider_3)
byCoordinates = Point.ByCoordinates(x=getItemAtIndex, y=getItemAtIndex_2, z=getItemAtIndex_3)

# group: PARAMENTO ONDE O GRAMPO ESTÁ LOCALIZADO
select_face = DSFaceSelection()  # 1 picked in the model
family_types = FamilyTypes("CS05-GRAMPO:GRAMPO")
ꟿ_familyinstance_byfaceandpoint = Custom[ꟿ FamilyInstance.ByFaceAndPoint](face=select_face, type=family_types, point=byCoordinates)  # package spring nodes; Places instances on the input face oriented to the face's U tangent and the global Z axis.

# group: ROTAÇÃO DO GRAMPO
code_block = CodeBlock { 170; }
setRotation = FamilyInstance.SetRotation(familyInstance=ꟿ_familyinstance_byfaceandpoint, degree=code_block)

# group: IMPORTAR COORDENADAS EXCEL
file_path_2 = Filename("..\01. CONTENÇÕES\05. CS05 SG +CT\Revit\COORDENADAS DOS GRAMPOS.xlsx")
file_from_path_2 = FileObject(path=file_path_2)
string_2 = StringInput("SOLIDO 2")
boolean_2 = BoolSelector(false)
importExcel_2 = Data.ImportExcel(file=file_from_path_2, sheetName=string_2, showExcel=boolean_2)

# group: TRANSFORMAR A LISTA EM PONTOS
transpose_2 = List.Transpose(lists=importExcel_2)
number_slider_4 = DoubleSlider(2, range=1..3 step 1)
getItemAtIndex_4 = List.GetItemAtIndex(list=transpose_2, index=number_slider_4)
number_slider_5 = DoubleSlider(1, range=1..3 step 1)
getItemAtIndex_5 = List.GetItemAtIndex(list=transpose_2, index=number_slider_5)
number_slider_6 = DoubleSlider(3, range=1..3 step 1)
getItemAtIndex_6 = List.GetItemAtIndex(list=transpose_2, index=number_slider_6)
byCoordinates_2 = Point.ByCoordinates(x=getItemAtIndex_4, y=getItemAtIndex_5, z=getItemAtIndex_6)

# group: PARAMENTO ONDE O GRAMPO ESTÁ LOCALIZADO
select_face_2 = DSFaceSelection()  # 1 picked in the model
family_types_2 = FamilyTypes("CS05-GRAMPO:GRAMPO")
ꟿ_familyinstance_byfaceandpoint_2 = Custom[ꟿ FamilyInstance.ByFaceAndPoint](face=select_face_2, type=family_types_2, point=byCoordinates_2)

# group: ROTAÇÃO DO GRAMPO
code_block_2 = CodeBlock { 170; }
setRotation_2 = FamilyInstance.SetRotation(familyInstance=ꟿ_familyinstance_byfaceandpoint_2, degree=code_block_2)

# group: IMPORTAR COORDENADAS EXCEL
file_path_3 = Filename("..\01. CONTENÇÕES\05. CS05 SG +CT\Revit\COORDENADAS DOS GRAMPOS.xlsx")
file_from_path_3 = FileObject(path=file_path_3)
string_3 = StringInput("SOLIDO 3")
boolean_3 = BoolSelector(false)
importExcel_3 = Data.ImportExcel(file=file_from_path_3, sheetName=string_3, showExcel=boolean_3)

# group: TRANSFORMAR A LISTA EM PONTOS
transpose_3 = List.Transpose(lists=importExcel_3)
number_slider_7 = DoubleSlider(2, range=1..3 step 1)
getItemAtIndex_7 = List.GetItemAtIndex(list=transpose_3, index=number_slider_7)
number_slider_8 = DoubleSlider(1, range=1..3 step 1)
getItemAtIndex_8 = List.GetItemAtIndex(list=transpose_3, index=number_slider_8)
number_slider_9 = DoubleSlider(3, range=1..3 step 1)
getItemAtIndex_9 = List.GetItemAtIndex(list=transpose_3, index=number_slider_9)
byCoordinates_3 = Point.ByCoordinates(x=getItemAtIndex_7, y=getItemAtIndex_8, z=getItemAtIndex_9)

# group: PARAMENTO ONDE O GRAMPO ESTÁ LOCALIZADO
select_face_3 = DSFaceSelection()  # 1 picked in the model
family_types_3 = FamilyTypes("CS05-GRAMPO:GRAMPO")
ꟿ_familyinstance_byfaceandpoint_3 = Custom[ꟿ FamilyInstance.ByFaceAndPoint](face=select_face_3, type=family_types_3, point=byCoordinates_3)

# group: ROTAÇÃO DO GRAMPO
code_block_3 = CodeBlock { 170; }
setRotation_3 = FamilyInstance.SetRotation(familyInstance=ꟿ_familyinstance_byfaceandpoint_3, degree=code_block_3)

# group: IMPORTAR COORDENADAS EXCEL
file_path_4 = Filename("..\01. CONTENÇÕES\05. CS05 SG +CT\Revit\COORDENADAS DOS GRAMPOS.xlsx")
file_from_path_4 = FileObject(path=file_path_4)
string_4 = StringInput("SOLIDO 4")
boolean_4 = BoolSelector(false)
importExcel_4 = Data.ImportExcel(file=file_from_path_4, sheetName=string_4, showExcel=boolean_4)

# group: TRANSFORMAR A LISTA EM PONTOS
transpose_4 = List.Transpose(lists=importExcel_4)
number_slider_10 = DoubleSlider(2, range=1..3 step 1)
getItemAtIndex_10 = List.GetItemAtIndex(list=transpose_4, index=number_slider_10)
number_slider_11 = DoubleSlider(1, range=1..3 step 1)
getItemAtIndex_11 = List.GetItemAtIndex(list=transpose_4, index=number_slider_11)
number_slider_12 = DoubleSlider(3, range=1..3 step 1)
getItemAtIndex_12 = List.GetItemAtIndex(list=transpose_4, index=number_slider_12)
byCoordinates_4 = Point.ByCoordinates(x=getItemAtIndex_10, y=getItemAtIndex_11, z=getItemAtIndex_12)

# group: PARAMENTO ONDE O GRAMPO ESTÁ LOCALIZADO
select_face_4 = DSFaceSelection()  # 1 picked in the model
family_types_4 = FamilyTypes("CS05-GRAMPO:GRAMPO")
ꟿ_familyinstance_byfaceandpoint_4 = Custom[ꟿ FamilyInstance.ByFaceAndPoint](face=select_face_4, type=family_types_4, point=byCoordinates_4)

# group: ROTAÇÃO DO GRAMPO
code_block_4 = CodeBlock { 170; }
setRotation_4 = FamilyInstance.SetRotation(familyInstance=ꟿ_familyinstance_byfaceandpoint_4, degree=code_block_4)

# group: IMPORTAR COORDENADAS EXCEL
file_path_5 = Filename("..\01. CONTENÇÕES\05. CS05 SG +CT\Revit\COORDENADAS DOS GRAMPOS.xlsx")
file_from_path_5 = FileObject(path=file_path_5)
string_5 = StringInput("SOLIDO 5")
boolean_5 = BoolSelector(false)
importExcel_5 = Data.ImportExcel(file=file_from_path_5, sheetName=string_5, showExcel=boolean_5)

# group: TRANSFORMAR A LISTA EM PONTOS
transpose_5 = List.Transpose(lists=importExcel_5)
number_slider_13 = DoubleSlider(2, range=1..3 step 1)
getItemAtIndex_13 = List.GetItemAtIndex(list=transpose_5, index=number_slider_13)
number_slider_14 = DoubleSlider(1, range=1..3 step 1)
getItemAtIndex_14 = List.GetItemAtIndex(list=transpose_5, index=number_slider_14)
number_slider_15 = DoubleSlider(3, range=1..3 step 1)
getItemAtIndex_15 = List.GetItemAtIndex(list=transpose_5, index=number_slider_15)
byCoordinates_5 = Point.ByCoordinates(x=getItemAtIndex_13, y=getItemAtIndex_14, z=getItemAtIndex_15)

# group: PARAMENTO ONDE O GRAMPO ESTÁ LOCALIZADO
select_face_5 = DSFaceSelection()  # 1 picked in the model
family_types_5 = FamilyTypes("CS05-GRAMPO:GRAMPO")
ꟿ_familyinstance_byfaceandpoint_5 = Custom[ꟿ FamilyInstance.ByFaceAndPoint](face=select_face_5, type=family_types_5, point=byCoordinates_5)

# group: ROTAÇÃO DO GRAMPO
code_block_5 = CodeBlock { 170; }
setRotation_5 = FamilyInstance.SetRotation(familyInstance=ꟿ_familyinstance_byfaceandpoint_5, degree=code_block_5)
