# Dynamo graph Superficie_ger_alpha.dyn (Dynamo 3.2.1.5366)

file_path = Filename("..\..\..\..\Favorites\teste_surface.txt")
readText = FileSystem.ReadText(file=file_path)
watch = Watch(readText)
code_block = CodeBlock { "\n"; }
split = String.Split(string=readText, separator0=code_block)
watch_2 = Watch(split)
code_block_2 = CodeBlock { ","; }
split_2 = String.Split(string=split, separator0=code_block_2)
watch_3 = Watch(split_2)
toNumber = String.ToNumber(string=split_2)
watch_4 = Watch(toNumber)
transpose = List.Transpose(lists=toNumber)
code_block_3 = CodeBlock(data=transpose)
# ---------- code_block_3.designscript (6 lines) ----------
// 'data' é a nossa lista transposta vinda do nó List.Transpose
xs = data[0];
ys = data[1];
zs = data[2];

Point.ByCoordinates(xs, ys, zs);
# ----------------------------------------
watch_5 = Watch(code_block_3.out3)
watch_6 = Watch(transpose)
code_block_4 = CodeBlock { 4; }
chop = List.Chop(list=code_block_3.out3, lengths=code_block_4)
watch_7 = Watch(chop)
uniqueItems = List.UniqueItems(list=chop@L2)
watch_8 = Watch(uniqueItems)
code_block_5 = CodeBlock { 0.5; }
normalAtParameter = Surface.NormalAtParameter(u=code_block_5, v=code_block_5)  # unwired: surface
Z = Vector.Z(vector=normalAtParameter)
abs = Math.Abs(number=Z)
number_slider = DoubleSlider(1, range=0..100 step 0.1)
lt = abs < number_slider
filterByBoolMask = List.FilterByBoolMask(mask=lt)  # unwired: list
byJoinedSurfaces = PolySurface.ByJoinedSurfaces(surfaces=filterByBoolMask.in)
byPerimeterPoints = Surface.ByPerimeterPoints(points=uniqueItems)
code_block_6 = CodeBlock { 0.3; }
thicken = Surface.Thicken(surface=byPerimeterPoints, thickness=code_block_6)
byGeometry = ImportInstance.ByGeometry(geometry=thicken)
