# Dynamo graph teste_familia.dyn (Dynamo 3.2.1.5366)

file_path = Filename("..\..\..\..\Favorites\teste_surface.txt")
python_script = Python(IN[0]=file_path)  # CPython3
# ---------- python_script.python (98 lines) ----------
# Importações Corretas e Seguras
import clr
clr.AddReference("ProtoGeometry")
import Autodesk.DesignScript.Geometry as DS # Apelido para Geometria do Dynamo

clr.AddReference('RevitAPI')
import Autodesk.Revit.DB as DB # Apelido para API do Revit

clr.AddReference('RevitServices')
import RevitServices
from RevitServices.Persistence import DocumentManager
from RevitServices.Transactions import TransactionManager

import locale

# --- PASSO 0: CONFIGURAÇÃO ---
try:
    locale.setlocale(locale.LC_NUMERIC, 'C')
except:
    pass

doc = DocumentManager.Instance.CurrentDBDocument
filepath = IN[0]

# --- PASSO 1: PRÉ-PROCESSAMENTO E LIMPEZA DOS DADOS (SUA LÓGICA) ---
# Esta é a etapa mais importante, baseada na sua análise.
cleaned_lines = []
raw_lines = []
error_message = None

try:
    with open(filepath, 'r', encoding='utf-8-sig') as f:
        raw_lines = f.readlines()
    
    # Itera sobre o arquivo, pegando 3 linhas e pulando a 4ª
    for i in range(0, len(raw_lines), 4):
        # Garante que temos um grupo completo de 3 para adicionar
        if i + 2 < len(raw_lines):
            cleaned_lines.append(raw_lines[i])
            cleaned_lines.append(raw_lines[i+1])
            cleaned_lines.append(raw_lines[i+2])

    # --- PASSO 2: LEITURA DOS PONTOS A PARTIR DOS DADOS LIMPOS ---
    points = []
    for line in cleaned_lines:
        line = line.strip()
        if line:
            parts = line.split(',')
            if len(parts) == 3:
                x = float(parts[0])
                y = float(parts[1])
                z = float(parts[2])
                points.append(DS.Point.ByCoordinates(x, y, z))
except Exception as e:
    error_message = "Erro ao ler ou processar o arquivo: " + str(e)


# --- PASSO 3: CONSTRUÇÃO FINAL E ENVIO PARA O REVIT ---
if not error_message:
    if points:
        # Cria a lista de faces triangulares a partir dos pontos limpos
        face_indices_groups = []
        # Os pontos já estão limpos e ordenados. Basta criar os índices.
        for i in range(0, len(points) // 3):
            idx1 = i * 3
            idx2 = i * 3 + 1
            idx3 = i * 3 + 2
            face_indices_groups.append(DS.IndexGroup.ByIndices(idx1, idx2, idx3))

        if face_indices_groups:
            try:
                # Cria UMA ÚNICA MALHA a partir de todos os pontos e faces
                final_mesh = DS.Mesh.ByPointsFaceIndices(points, face_indices_groups)
                
                if final_mesh:
                    # Converte a malha para o formato do Revit
                    revit_geoms = final_mesh.ToRevitType()
                    
                    TransactionManager.Instance.EnsureInTransaction(doc)
                    
                    # Usa DirectShape, a ferramenta correta para esta geometria
                    catId = DB.ElementId(DB.BuiltInCategory.OST_GenericModel)
                    ds = DB.DirectShape.CreateElement(doc, catId)
                    ds.SetShape(revit_geoms)
                    
                    TransactionManager.Instance.TransactionTaskDone()
                    
                    OUT = "SUCESSO. Geometria criada usando sua lógica de limpeza de dados."
                else:
                    OUT = "Falha. A malha final não pôde ser criada com os dados limpos."
            except Exception as e:
                OUT = "Erro final ao criar a malha ou enviá-la para o Revit: " + str(e)
        else:
            OUT = "FALHA: Nenhuma face válida pôde ser criada a partir dos dados limpos."
    else:
        OUT = "FALHA FINAL: Nenhum ponto foi processado após a limpeza do arquivo."
else:
    OUT = error_message
# ----------------------------------------
watch = Watch(python_script)
