# Dynamo graph teste_solido_gen.dyn (Dynamo 3.2.1.5366)

lista_pontos_unicos = Python()  # CPython3; unwired: IN[0]
# ---------- lista_pontos_unicos.python (45 lines) ----------
# SCRIPT 01: Encontrar Vértices Únicos
import clr
clr.AddReference('ProtoGeometry')
from Autodesk.DesignScript.Geometry import Point
import sys

# Pega o caminho do arquivo da primeira entrada
filepath = IN[0]
file_content = ""

# Tenta ler o conteúdo do arquivo de texto
try:
    with open(filepath, 'r') as f:
        file_content = f.read()
except Exception as e:
    OUT = "ERRO AO LER O ARQUIVO: " + str(e)
    sys.exit()

# Separa o conteúdo em linhas
lines = file_content.strip().split('\n')

# Listas para armazenar os pontos únicos e um mapa para evitar duplicatas
unique_points = []
point_map = {} # Dicionário para rastrear pontos já adicionados

# Itera por todas as linhas do arquivo
for line in lines:
    if line.strip():
        # A coordenada em texto (ex: "1.0,2.0,3.0") é a chave de verificação
        line_key = line.strip()
        
        # Se este ponto ainda não foi visto...
        if line_key not in point_map:
            try:
                # ...cria o ponto, adiciona na lista e registra no mapa
                coords = line.split(',')
                pt = Point.ByCoordinates(float(coords[0]), float(coords[1]), float(coords[2]))
                point_map[line_key] = len(unique_points) # Registra o índice do novo ponto
                unique_points.append(pt)
            except:
                # Ignora linhas mal formatadas
                pass

# A única saída deste script é a lista de pontos únicos
OUT = unique_points
# ----------------------------------------
lista_indices_de_cada_face = Python()  # CPython3; unwired: IN[0]
# ---------- lista_indices_de_cada_face.python (50 lines) ----------
# SCRIPT 02: Montar Índices das Faces (VERSÃO FINAL)
import clr
import sys

# Importa o tipo de dado específico que o nó Mesh precisa
from Autodesk.DesignScript.Geometry import IndexGroup

# Pega o caminho do arquivo da primeira entrada
filepath = IN[0]
file_content = ""

# Tenta ler o conteúdo do arquivo
try:
    with open(filepath, 'r') as f:
        file_content = f.read()
except Exception as e:
    OUT = "ERRO AO LER O ARQUIVO: " + str(e)
    sys.exit()

# Recria o mapa de pontos para encontrar os índices
lines = file_content.strip().split('\n')
point_map = {}
temp_unique_points_count = 0
for line in lines:
    if line.strip():
        line_key = line.strip()
        if line_key not in point_map:
            point_map[line_key] = temp_unique_points_count
            temp_unique_points_count += 1

# Monta os índices das faces
face_indices = []
for i in range(0, len(lines), 4):
    face_lines = lines[i:i+3]
    current_face_indices = []
    
    if len(face_lines) == 3:
        for line in face_lines:
            if line.strip():
                line_key = line.strip()
                idx = point_map[line_key]
                current_face_indices.append(idx)
        
        if len(current_face_indices) == 3:
            # --- CORREÇÃO FINAL ---
            # O asterisco (*) desempacota a lista em argumentos individuais
            face_indices.append(IndexGroup.ByIndices(*current_face_indices))

# A saída agora é uma lista de objetos IndexGroup, o tipo de dado correto.
OUT = face_indices
# ----------------------------------------
number_slider = DoubleSlider(0.3, range=0..100 step 0.1)
encontrar_perímetro = Python()  # CPython3; unwired: IN[0]
# ---------- encontrar_perímetro.python (31 lines) ----------
# SCRIPT 4: Encontrar Arestas do Perímetro (Arestas Nuas)
import clr

# Pega a lista de IndexGroup da entrada
index_groups = IN[0]

# Um dicionário para contar quantas vezes cada aresta aparece
edge_counts = {}

# Itera por cada face (triângulo) da nossa malha
for group in index_groups:
    indices = [group.A, group.B, group.C]
    
    # Gera as 3 arestas de cada triângulo
    # Usamos min/max para normalizar a aresta (ex: a aresta 5-10 é a mesma que 10-5)
    edges = [
        tuple(sorted((indices[0], indices[1]))),
        tuple(sorted((indices[1], indices[2]))),
        tuple(sorted((indices[2], indices[0])))
    ]
    
    # Conta cada aresta
    for edge in edges:
        edge_counts[edge] = edge_counts.get(edge, 0) + 1

# Filtra o dicionário para encontrar as arestas que só apareceram 1 vez
# Essas são as arestas do perímetro (as arestas "nuas")
naked_edges = [edge for edge, count in edge_counts.items() if count == 1]

# A saída é uma lista de pares de índices (ex: [[5,10], [10, 18], ...])
OUT = naked_edges
# ----------------------------------------
final = Python()  # CPython3; unwired: IN[0], IN[1], IN[2], IN[3], IN[4]
# ---------- final.python (83 lines) ----------
# SCRIPT 5 (VERSÃO FINAL): Construir Sólido com Offset por Normais
import clr

# Importações necessárias da API do Revit e do Dynamo
clr.AddReference("RevitAPI")
from Autodesk.Revit.DB import TessellatedShapeBuilder, TessellatedShapeBuilderTarget, TessellatedShapeBuilderFallback, TessellatedFace, XYZ, DirectShape, ElementId, BuiltInCategory, TessellatedShapeBuilderOutcome
from System.Collections.Generic import List

clr.AddReference("RevitServices")
import RevitServices
from RevitServices.Persistence import DocumentManager
from RevitServices.Transactions import TransactionManager

# --- Pegar os Dados das Entradas ---
dynamo_points = IN[0]
index_groups = IN[1]
naked_edges_indices = IN[2]
thickness = IN[3]
vertex_normals_dynamo = IN[4] # <<<<<< NOVA ENTRADA

# --- Preparação dos Dados ---
# Converte os pontos do Dynamo para o formato XYZ do Revit
top_points_rvt = [XYZ(pt.X, pt.Y, pt.Z) for pt in dynamo_points]
# Converte os vetores normais do Dynamo para o formato XYZ do Revit
vertex_normals_rvt = [XYZ(v.X, v.Y, v.Z) for v in vertex_normals_dynamo]

# >>>>>> ESTA É A MUDANÇA PRINCIPAL <<<<<<
# Cria os pontos da base movendo cada ponto do topo ao longo de sua normal
bottom_points_rvt = []
for i in range(len(top_points_rvt)):
    top_point = top_points_rvt[i]
    normal_vector = vertex_normals_rvt[i]
    # Multiplica o vetor normal (de comprimento 1) pela espessura desejada
    offset_vector = normal_vector.Multiply(thickness)
    # Subtrai o vetor de offset do ponto do topo para encontrar o ponto da base
    bottom_point = top_point.Subtract(offset_vector)
    bottom_points_rvt.append(bottom_point)

# Pega o documento atual do Revit
doc = DocumentManager.Instance.CurrentDBDocument

# --- O RESTO DO CÓDIGO É IDÊNTICO ---

# Garante que estamos dentro de uma transação do Revit
TransactionManager.Instance.EnsureInTransaction(doc)
builder = TessellatedShapeBuilder()
builder.OpenConnectedFaceSet(True)

# 1. Adicionar as Faces do TOPO
for group in index_groups:
    face_loop = List[XYZ](); face_loop.Add(top_points_rvt[group.A]); face_loop.Add(top_points_rvt[group.B]); face_loop.Add(top_points_rvt[group.C])
    builder.AddFace(TessellatedFace(face_loop, ElementId.InvalidElementId))

# 2. Adicionar as Faces da BASE
for group in index_groups:
    face_loop = List[XYZ](); face_loop.Add(bottom_points_rvt[group.A]); face_loop.Add(bottom_points_rvt[group.C]); face_loop.Add(bottom_points_rvt[group.B])
    builder.AddFace(TessellatedFace(face_loop, ElementId.InvalidElementId))
    
# 3. Adicionar as Faces LATERAIS
for edge in naked_edges_indices:
    idx1, idx2 = edge[0], edge[1]
    face_loop = List[XYZ](); face_loop.Add(top_points_rvt[idx1]); face_loop.Add(top_points_rvt[idx2]); face_loop.Add(bottom_points_rvt[idx2]); face_loop.Add(bottom_points_rvt[idx1])
    builder.AddFace(TessellatedFace(face_loop, ElementId.InvalidElementId))

# Finaliza a Construção
builder.CloseConnectedFaceSet()
builder.Target = TessellatedShapeBuilderTarget.Solid
builder.Fallback = TessellatedShapeBuilderFallback.Abort
builder.Build()
result = builder.GetBuildResult()

# Criar o Elemento no Revit
final_object = None
if result.Outcome == TessellatedShapeBuilderOutcome.Solid:
    geom_objects = result.GetGeometricalObjects()
    ds = DirectShape.CreateElement(doc, ElementId(BuiltInCategory.OST_GenericModel))
    ds.SetShape(geom_objects)
    final_object = ds
else:
    final_object = "Falha ao criar o sólido: " + str(result.Outcome)

TransactionManager.Instance.TransactionTaskDone()
OUT = final_object
# ----------------------------------------
calcular_normais_dos_vértices = Python()  # CPython3; unwired: IN[0], IN[1]
# ---------- calcular_normais_dos_vértices.python (45 lines) ----------
# SCRIPT 6: Calcular Normais dos Vértices (VERSÃO CORRIGIDA E ROBUSTA)
import clr
clr.AddReference("RevitAPI")
from Autodesk.Revit.DB import XYZ

# Pega os dados das entradas
dynamo_points = IN[0]
index_groups = IN[1]

# Converte pontos do Dynamo para o formato XYZ do Revit
points_rvt = [XYZ(pt.X, pt.Y, pt.Z) for pt in dynamo_points]

# 1. Calcular a normal de cada face (triângulo)
face_normals = []
# Define um vetor de referência "para cima"
z_axis = XYZ.BasisZ

for group in index_groups:
    p1 = points_rvt[group.A]
    p2 = points_rvt[group.B]
    p3 = points_rvt[group.C]
    v1 = p2.Subtract(p1)
    v2 = p3.Subtract(p1)
    normal = v1.CrossProduct(v2).Normalize()
    
    # >>>>>> ESTA É A CORREÇÃO CRUCIAL <<<<<<
    # Garante que a normal sempre aponte para cima (no eixo Z)
    # Se o ângulo entre a normal e o eixo Z for maior que 90 graus, ela está de cabeça para baixo
    if normal.DotProduct(z_axis) < 0:
        normal = normal.Negate() # Inverte a normal
        
    face_normals.append(normal)
    
# 2. Calcular a normal de cada vértice (o resto do código é o mesmo)
vertex_normals = [XYZ.Zero for _ in points_rvt]
for i, group in enumerate(index_groups):
    vertex_normals[group.A] = vertex_normals[group.A].Add(face_normals[i])
    vertex_normals[group.B] = vertex_normals[group.B].Add(face_normals[i])
    vertex_normals[group.C] = vertex_normals[group.C].Add(face_normals[i])

# 3. Finaliza normalizando cada um dos vetores de vértice resultantes
final_vertex_normals = [v.Normalize() for v in vertex_normals]

# A saída é uma lista de vetores normais consistentes
OUT = final_vertex_normals
# ----------------------------------------
file_path = Filename("C:\Users\Geologia\Favorites\teste_surface.txt")
vertices = Python(IN[0]=file_path)  # CPython3
# ---------- vertices.python (30 lines) ----------
# SCRIPT 1: Encontrar Vértices Únicos
import clr
clr.AddReference('ProtoGeometry')
from Autodesk.DesignScript.Geometry import Point
import sys

filepath = IN[0]
file_content = ""
try:
    with open(filepath, 'r') as f:
        file_content = f.read()
except Exception as e:
    OUT = "ERRO AO LER O ARQUIVO: " + str(e)
    sys.exit()

lines = file_content.strip().split('\n')
unique_points = []
point_map = {}
for line in lines:
    if line.strip():
        line_key = line.strip()
        if line_key not in point_map:
            try:
                coords = line.split(',')
                pt = Point.ByCoordinates(float(coords[0]), float(coords[1]), float(coords[2]))
                point_map[line_key] = len(unique_points)
                unique_points.append(pt)
            except:
                pass
OUT = unique_points
# ----------------------------------------
indices = Python(IN[0]=file_path)  # CPython3
# ---------- indices.python (37 lines) ----------
# SCRIPT 2: Montar Índices das Faces
import clr
import sys
from Autodesk.DesignScript.Geometry import IndexGroup

filepath = IN[0]
file_content = ""
try:
    with open(filepath, 'r') as f:
        file_content = f.read()
except Exception as e:
    OUT = "ERRO AO LER O ARQUIVO: " + str(e)
    sys.exit()

lines = file_content.strip().split('\n')
point_map = {}
temp_unique_points_count = 0
for line in lines:
    if line.strip():
        line_key = line.strip()
        if line_key not in point_map:
            point_map[line_key] = temp_unique_points_count
            temp_unique_points_count += 1

face_indices = []
for i in range(0, len(lines), 4):
    face_lines = lines[i:i+3]
    current_face_indices = []
    if len(face_lines) == 3:
        for line in face_lines:
            if line.strip():
                line_key = line.strip()
                idx = point_map[line_key]
                current_face_indices.append(idx)
        if len(current_face_indices) == 3:
            face_indices.append(IndexGroup.ByIndices(*current_face_indices))
OUT = face_indices
# ----------------------------------------
reconstruir_superfícies = Python(IN[0]=vertices, IN[1]=indices)  # CPython3
# ---------- reconstruir_superfícies.python (15 lines) ----------
# SCRIPT 3: Reconstruir Superfícies Limpas
import clr
clr.AddReference('ProtoGeometry')
from Autodesk.DesignScript.Geometry import Surface, PolyCurve

points = IN[0]
index_groups = IN[1]
surfaces = []
for group in index_groups:
    idx1, idx2, idx3 = group.A, group.B, group.C
    pt1, pt2, pt3 = points[idx1], points[idx2], points[idx3]
    polycurve = PolyCurve.ByPoints([pt1, pt2, pt3], True)
    surface = Surface.ByPatch(polycurve)
    surfaces.append(surface)
OUT = surfaces
# ----------------------------------------
number_slider_2 = DoubleSlider(0.2, range=0..100 step 0.1)
boolean = BoolSelector(false)
thicken = Surface.Thicken(surface=reconstruir_superfícies, thickness=number_slider_2, both_sides=boolean)
byGeometry = ImportInstance.ByGeometry()  # unwired: geometry
byJoinedSurfaces = PolySurface.ByJoinedSurfaces(surfaces=reconstruir_superfícies)
byGeometry_2 = ImportInstance.ByGeometry(geometry=byJoinedSurfaces)
