# Dynamo graph primeiro_dynamo.dyn (Dynamo 2.19.3.6394)

file_path = Filename("..\..\..\Favorites\teste_1.txt")  # graph input
leitura_e_lista_de_pontos_da = Python(IN[0]=file_path)  # "Leitura e lista de pontos da linha"; CPython3
# ---------- leitura_e_lista_de_pontos_da.python (84 lines) ----------
import clr
import re # Para expressões regulares (limpeza)

# Importa a geometria do Dynamo
clr.AddReference('ProtoGeometry')
from Autodesk.DesignScript.Geometry import Point, Vector

# INPUTS
filePath = IN[0]
# Defina aqui se você quer criar "Point" ou "Vector"
# Isso será útil quando adaptarmos para o segundo arquivo.
output_type = "Point" # Mude para "Vector" para o outro arquivo

# OUTPUT
created_geometry = []
debug_messages = []

try:
    with open(filePath, 'r', encoding='utf-8') as f: # Especifica UTF-8
        lines = f.readlines()

    if not lines:
        debug_messages.append("Arquivo TXT está vazio ou não pôde ser lido.")
    
    for i, line_content in enumerate(lines):
        original_line = line_content.strip() # Remove espaços/quebras de linha no início/fim da linha
        
        if not original_line: # Pula linhas completamente vazias
            debug_messages.append("Linha " + str(i+1) + " está vazia, pulando.")
            continue

        # Tentativa de limpeza agressiva de caracteres não esperados
        # Mantém apenas dígitos, vírgula, ponto (decimal) e sinal de menos.
        cleaned_line = re.sub(r'[^\d,\.\-]', '', original_line)
        
        parts = cleaned_line.split(',')
        
        debug_messages.append("Linha " + str(i+1) + " | Original: '" + original_line + "' | Limpa: '" + cleaned_line + "' | Partes: " + str(len(parts)) + " (" + ", ".join(parts) + ")")

        if len(parts) == 3:
            try:
                x_str, y_str, z_str = parts[0].strip(), parts[1].strip(), parts[2].strip()
                
                # Verifica se as strings não estão vazias após a limpeza e strip
                if x_str and y_str and z_str:
                    x = float(x_str)
                    y = float(y_str)
                    z = float(z_str)
                    
                    if output_type == "Point":
                        geom = Point.ByCoordinates(x, y, z)
                        created_geometry.append(geom)
                    elif output_type == "Vector":
                        geom = Vector.ByCoordinates(x, y, z)
                        created_geometry.append(geom)
                    else:
                        created_geometry.append("Erro: output_type desconhecido.")
                else:
                    created_geometry.append("Erro na Linha " + str(i+1) + ": Uma das coordenadas ficou vazia após limpeza. Limpa: '" + cleaned_line + "'")
            except ValueError:
                created_geometry.append("Erro na Linha " + str(i+1) + ": Não foi possível converter para número. Partes: " + str(parts))
        else:
            created_geometry.append("Erro na Linha " + str(i+1) + ": Número incorreto de partes (" + str(len(parts)) + "). Limpa: '" + cleaned_line + "'")

except IOError:
    debug_messages.append("Erro: Não foi possível abrir ou ler o arquivo: " + filePath)
    created_geometry.append("Falha ao ler arquivo.")
except Exception as e:
    debug_messages.append("Erro inesperado no Python: " + str(e))
    created_geometry.append("Erro Python.")

# Para facilitar a visualização, vamos enviar as mensagens de debug e a geometria em saídas separadas
# Modifique o nó Python para ter duas saídas (clique no '+' na parte inferior do nó)
# e nomeie as saídas como OUT[0] e OUT[1] no script se necessário,
# ou use um nó List.Create para combiná-los se só tiver uma saída.
# Por agora, vamos focar na geometria criada.
# Se quiser ver o debug, mude OUT = debug_messages

OUT = created_geometry
# Para ver o debug, você pode temporariamente fazer:
# OUT = debug_messages
# Ou, se adicionar uma segunda porta de saída ao nó Python (IN[0], IN[1]... OUT[0], OUT[1]):
# OUT = [created_geometry, debug_messages] 
# E aí você conectaria dois nós Watch.
# ----------------------------------------
watch = Watch(leitura_e_lista_de_pontos_da)
boolean = BoolSelector(false)
byPoints = PolyCurve.ByPoints(points=watch, connectLastToFirst=boolean)
watch_2 = Watch(byPoints)
criação_de_vetores = Python(IN[0]=leitura_e_lista_de_pontos_da)  # CPython3
# ---------- criação_de_vetores.python (19 lines) ----------
import clr
clr.AddReference('ProtoGeometry')
from Autodesk.DesignScript.Geometry import Vector, Point

points_list = IN[0]
created_vectors = []

if isinstance(points_list, list) and len(points_list) >= 2:
    for i in range(len(points_list) - 1):
        start_point = points_list[i]
        end_point = points_list[i+1]
        
        if isinstance(start_point, Point) and isinstance(end_point, Point):
            vec = Vector.ByTwoPoints(start_point, end_point)
            created_vectors.append(vec)
        # else: erro de item não ser Ponto (pode adicionar mensagens de erro se quiser)
# else: erro de poucos pontos ou entrada inválida (pode adicionar mensagens de erro)

OUT = created_vectors
# ----------------------------------------
watch_3 = Watch(criação_de_vetores)
pontos_de_inserção = Python(IN[0]=leitura_e_lista_de_pontos_da)  # CPython3
# ---------- pontos_de_inserção.python (35 lines) ----------
import clr
clr.AddReference('ProtoGeometry')
from Autodesk.DesignScript.Geometry import Point

# Lista de Pontos da entrada (os vértices do eixo do muro)
points_list = IN[0]
mid_points = []

# Verifica se temos pelo menos 2 pontos para encontrar um ponto médio entre eles
if isinstance(points_list, list) and len(points_list) >= 2:
    for i in range(len(points_list) - 1):
        p1 = points_list[i]
        p2 = points_list[i+1]
        
        # Verifica se os itens são realmente Pontos
        if isinstance(p1, Point) and isinstance(p2, Point):
            # Calcula as coordenadas do ponto médio
            mid_x = (p1.X + p2.X) / 2.0
            mid_y = (p1.Y + p2.Y) / 2.0
            mid_z = (p1.Z + p2.Z) / 2.0
            
            # Cria o Ponto Médio
            mid_pt = Point.ByCoordinates(mid_x, mid_y, mid_z)
            mid_points.append(mid_pt)
        else:
            # Adiciona None ou uma mensagem de erro se os itens não forem Pontos
            mid_points.append(None) # Ou uma string de erro: "Erro: p1 ou p2 não é Ponto"
elif isinstance(points_list, list) and len(points_list) < 2:
    # Adiciona None ou uma mensagem se não houver pontos suficientes
    mid_points.append(None) # Ou "Erro: Menos de 2 pontos fornecidos"
else:
    # Adiciona None ou uma mensagem se a entrada não for uma lista
    mid_points.append(None) # Ou "Erro: Entrada IN[0] não é uma lista"

OUT = mid_points
# ----------------------------------------
watch_4 = Watch(pontos_de_inserção)
family_types = FamilyTypes("Terramesh System:Caixa 2.0 x 0.5 x 4.0")  # graph input
byPoint = FamilyInstance.ByPoint(familyType=family_types, point=pontos_de_inserção)
watch_5 = Watch(byPoint)
python_script = Python(IN[0]=criação_de_vetores)  # CPython3
# ---------- python_script.python (34 lines) ----------
import math
import clr
clr.AddReference('ProtoGeometry')
from Autodesk.DesignScript.Geometry import Vector

# Lista de vetores da entrada
input_vectors = IN[0]
angles_in_degrees = []

if isinstance(input_vectors, list):
    for vec in input_vectors:
        if isinstance(vec, Vector):
            # math.atan2(y, x) retorna o ângulo em radianos entre 
            # o eixo X positivo e o ponto (x, y).
            angle_radians = math.atan2(vec.Y, vec.X)
            
            # Converte radianos para graus
            angle_degrees = math.degrees(angle_radians)
            
            # INVERTE O SINAL DO ÂNGULO
            inverted_angle_degrees = -angle_degrees
            
            # Opcional: Normalizar o ângulo para 0-360 se desejar (após inversão)
            # Se você quiser garantir que o Revit receba sempre ângulos positivos
            # if inverted_angle_degrees < 0:
            #     inverted_angle_degrees += 360
            
            angles_in_degrees.append(inverted_angle_degrees)
        else:
            angles_in_degrees.append(None) 
else:
    angles_in_degrees.append("Erro: Entrada não é uma lista")

OUT = angles_in_degrees
# ----------------------------------------
setRotation = FamilyInstance.SetRotation(familyInstance=byPoint, degree=python_script)
