# Dynamo graph segundo_dynamo.dyn (Dynamo 2.19.3.6394)

# group: Título <Clique duas vezes aqui para editar o título do grupo>
# Descrição <Clique duas vezes aqui para editar a descrição do grupo>
family_types = FamilyTypes("Terramesh System:Caixa 2.0 x 0.5 x 4.0")
file_path = Filename("C:\Users\Geologia\Favorites\teste_export.txt")
coordenadas = Python(IN[0]=file_path)  # CPython3
# ---------- coordenadas.python (45 lines) ----------
# Importações necessárias para o Dynamo
import clr
clr.AddReference('ProtoGeometry')
from Autodesk.DesignScript.Geometry import Point

# ENTRADA: Recebe o caminho do arquivo TXT
filePath = IN[0]

# SAÍDA: Lista para armazenar os pontos criados
lista_de_pontos = []

# Tenta abrir e ler o arquivo
try:
    with open(filePath, 'r') as f:
        for linha in f:
            linha = linha.strip() # Remove espaços em branco e quebras de linha
            if linha: # Verifica se a linha não está vazia
                try:
                    # Divide a linha pela vírgula e converte para float
                    partes = linha.split(',')
                    x = float(partes[0])
                    y = float(partes[1])
                    z = float(partes[2])
                    
                    # Cria o Ponto do Dynamo
                    ponto = Point.ByCoordinates(x, y, z)
                    lista_de_pontos.append(ponto)
                except ValueError:
                    # Lida com linhas que não podem ser convertidas para float
                    # Você pode adicionar um log aqui se quiser
                    # print("Aviso: Linha mal formatada ignorada - " + linha)
                    pass # Ignora a linha e continua
                except IndexError:
                    # Lida com linhas que não têm todas as partes esperadas
                    # print("Aviso: Linha com dados insuficientes ignorada - " + linha)
                    pass # Ignora a linha e continua
                    
except IOError:
    # print("Erro: Não foi possível abrir ou ler o arquivo: " + filePath)
    # Retorna uma lista vazia ou uma mensagem de erro para o Dynamo
    lista_de_pontos = ["Erro ao ler o arquivo. Verifique o caminho."]


# Envia a lista de pontos para a saída do nó Python
OUT = lista_de_pontos
# ----------------------------------------
X = Point.X(point=coordenadas)
Y = Point.Y(point=coordenadas)
Z = Point.Z(point=coordenadas)
byCoordinates = FamilyInstance.ByCoordinates(familyType=family_types, x=X, y=Y, z=Z)
angulos = Python(IN[0]=file_path)  # CPython3
# ---------- angulos.python (43 lines) ----------
# Importar math para conversão de radianos para graus
import math

# ENTRADA: Recebe o caminho do arquivo TXT
filePath = IN[0]

# SAÍDA: Lista para armazenar os ângulos (com sinal invertido)
lista_de_angulos = []

# Tenta abrir e ler o arquivo
try:
    with open(filePath, 'r') as f:
        for linha in f:
            linha = linha.strip() # Remove espaços em branco e quebras de linha
            if linha: # Verifica se a linha não está vazia
                try:
                    # Divide a linha pela vírgula
                    partes = linha.split(',')
                    # Converte o quarto elemento (ângulo) para float
                    angulo_radianos = float(partes[3])
                    
                    # Convertendo radianos para graus
                    angulo_graus = math.degrees(angulo_radianos)
                    
                    # Inverte o sinal do ângulo
                    angulo_graus_invertido = -angulo_graus 
                                        
                    lista_de_angulos.append(angulo_graus_invertido) # Adiciona o ângulo com sinal invertido
                except ValueError:
                    # Lida com linhas que não podem ser convertidas para float
                    # print("Aviso: Linha mal formatada ignorada - " + linha)
                    pass
                except IndexError:
                    # Lida com linhas que não têm todas as partes esperadas (por exemplo, menos de 4 valores)
                    # print("Aviso: Linha com dados insuficientes para ângulo ignorada - " + linha)
                    pass
                    
except IOError:
    # print("Erro: Não foi possível abrir ou ler o arquivo: " + filePath)
    lista_de_angulos = ["Erro ao ler o arquivo. Verifique o caminho."] # Informa o erro na saída do Dynamo

# Envia a lista de ângulos (com sinal invertido) para a saída do nó Python
OUT = lista_de_angulos
# ----------------------------------------
setRotation = FamilyInstance.SetRotation(familyInstance=byCoordinates, degree=angulos)
watch = Watch(coordenadas)
watch_2 = Watch(angulos)

# group: Título <Clique duas vezes aqui para editar o título do grupo>
# Descrição <Clique duas vezes aqui para editar a descrição do grupo>
family_types_2 = FamilyTypes("Terramesh System:Caixa 2.0 x 0.5 x 4.0")
file_path_2 = Filename("Nenhum arquivo selecionado.")
coordenadas_2 = Python(IN[0]=file_path_2)  # CPython3; same code as coordenadas
X_2 = Point.X(point=coordenadas_2)
Y_2 = Point.Y(point=coordenadas_2)
Z_2 = Point.Z(point=coordenadas_2)
byCoordinates_2 = FamilyInstance.ByCoordinates(familyType=family_types_2, x=X_2, y=Y_2, z=Z_2)
angulos_2 = Python(IN[0]=file_path_2)  # CPython3; same code as angulos
setRotation_2 = FamilyInstance.SetRotation(familyInstance=byCoordinates_2, degree=angulos_2)
watch_3 = Watch(angulos_2)
watch_4 = Watch(coordenadas_2)
